# Dynamo graph KDTree2D Example.dyn (Dynamo 2.3.0.5536)

# note: Todo: create 3D visualization of the UV points on an interesting surface :)

# group: 1. Create 100 points on a surface and give them names
code_block = CodeBlock { u = Math.RandomList(100); v = Math.RandomList(100); names = "id " + ((1..100) + ""); points = UV.ByCoordinates(u, v); }

# group: 2. Fill a KDTree2D with the points
byUVsAndObjects = SpacePartitioning.KDTree2D.ByUVsAndObjects(uvs=code_block.points, objects=code_block.names)

# group: 3. Use the KDTree2D to quickly find all the points within a certain distance from a test point
test_point = CodeBlock { p = UV.ByCoordinates(0.1, 0.1); }
search_radius = DoubleSlider(0.043, range=0.04..0.2 step 0.001)
findObjectsWithinRadius = SpacePartitioning.KDTree2D.FindObjectsWithinRadius(kDTree2D=byUVsAndObjects, testPoint=test_point, testRadius=search_radius)
watch = Watch(findObjectsWithinRadius.uvs)
watch_2 = Watch(findObjectsWithinRadius.objects)

# group: 4. Use the KDTree2D to quickly find the closest point in the original set to a test point
test_point_u = DoubleSlider(0.8166, range=0..1 step 0.0001)
test_point_v = DoubleSlider(0.4949, range=0..1 step 0.0001)
code_block_2 = CodeBlock(x=test_point_u, y=test_point_v) { p = UV.ByCoordinates(x, y); }
findNearestNeighbor = SpacePartitioning.KDTree2D.FindNearestNeighbor(kDTree2D=byUVsAndObjects, testPoint=code_block_2)
watch_3 = Watch(findNearestNeighbor.uv)
watch_4 = Watch(findNearestNeighbor.object)
