# Dynamo graph KDTree3D Example.dyn (Dynamo 2.3.0.5536)

# group: 1. Create 1000 points and give them names
code_block = CodeBlock()
# ---------- code_block.designscript (5 lines) ----------
x = Math.RandomList(1000) * 5;
y = Math.RandomList(1000) * 5;
z = Math.RandomList(1000) * 5;
names = "id " + ((1..1000) + "");
points = Point.ByCoordinates(x, y, z);
# ----------------------------------------
color_palette = ColorPalette({R: 112, G: 128, B: 144, A: 255})
byGeometryColor = Modifiers.GeometryColor.ByGeometryColor(geometry=code_block.points, color=color_palette)

# group: 2. Fill a KDTree3D with the points
byPointsAndObjects = SpacePartitioning.KDTree3D.ByPointsAndObjects(points=code_block.points, objects=code_block.names)

# group: 3. Use the KDTree3D to quickly find all the points within a certain distance from a test point
test_point = CodeBlock { p = Point.ByCoordinates(2, 2, 2); }
search_radius = DoubleSlider(1.489, range=0.1..5 step 0.001)
findObjectsWithinRadius = SpacePartitioning.KDTree3D.FindObjectsWithinRadius(kDTree3D=byPointsAndObjects, testPoint=test_point, testRadius=search_radius)
watch = Watch(findObjectsWithinRadius.points)
watch_2 = Watch(findObjectsWithinRadius.objects)
code_block_2 = CodeBlock { 0.03; }
byCenterPointRadius = Sphere.ByCenterPointRadius(centerPoint=findObjectsWithinRadius.points, radius=code_block_2)
color_palette_2 = ColorPalette({R: 255, G: 111, B: 0, A: 255})
byGeometryColor_2 = Modifiers.GeometryColor.ByGeometryColor(geometry=byCenterPointRadius, color=color_palette_2)
byCenterPointRadius_2 = Sphere.ByCenterPointRadius(centerPoint=test_point, radius=search_radius)
color_palette_3 = ColorPalette({R: 255, G: 14, B: 0, A: 51})
byGeometryColor_3 = Modifiers.GeometryColor.ByGeometryColor(geometry=byCenterPointRadius_2, color=color_palette_3)

# group: 4. Use the KDTree3D to quickly find the closest point in the original set to a test point
test_point_x = DoubleSlider(4.22, range=0..5 step 0.01)
test_point_y = DoubleSlider(0.76, range=0..5 step 0.01)
test_point_z = DoubleSlider(0.31, range=0..5 step 0.01)
code_block_3 = CodeBlock(x=test_point_x, y=test_point_y, z=test_point_z) { p = Point.ByCoordinates(x, y, z); r = 0.1; }
number_of_neighbors_to_find = IntegerSlider(4, range=1..10 step 1)
findNearestNeighbors = SpacePartitioning.KDTree3D.FindNearestNeighbors(kDTree3D=byPointsAndObjects, testPoint=code_block_3.p, numNeighbors=number_of_neighbors_to_find)
watch_3 = Watch(findNearestNeighbors.points)
watch_4 = Watch(findNearestNeighbors.objects)
byCenterPointRadius_3 = Sphere.ByCenterPointRadius(centerPoint=code_block_3.p, radius=code_block_3.r)
color_palette_4 = ColorPalette({R: 173, G: 255, B: 47, A: 255})
byGeometryColor_4 = Modifiers.GeometryColor.ByGeometryColor(geometry=byCenterPointRadius_3, color=color_palette_4)
code_block_4 = CodeBlock { 0.04; }
byCenterPointRadius_4 = Sphere.ByCenterPointRadius(centerPoint=findNearestNeighbors.points, radius=code_block_4)
color_palette_5 = ColorPalette({R: 255, G: 255, B: 0, A: 255})
byGeometryColor_5 = Modifiers.GeometryColor.ByGeometryColor(geometry=byCenterPointRadius_4, color=color_palette_5)
