# Dynamo graph Octree Simple Example.dyn (Dynamo 2.3.0.5536)

# group: 1. Create a collection of cuboids
code_block = CodeBlock()
# ---------- code_block.designscript (5 lines) ----------
a = 0..7..1;
b = 0.5..7.5..1;
c = 0..8..1;
lows = Point.ByCoordinates(a<1> ,a<2>, c<3>);
highs = Point.ByCoordinates(b<1>, b<2>, c<3> + 0.5);
# ----------------------------------------
byCorners = Cuboid.ByCorners(lowPoint=code_block.lows, highPoint=code_block.highs)
flatten = List.Flatten(list=byCorners)
color_palette = ColorPalette({R: 72, G: 209, B: 204, A: 40})
byGeometryColor = Modifiers.GeometryColor.ByGeometryColor(geometry=flatten, color=color_palette)

# group: 2. Fill an Octree with the cuboids and their bounding boxes
byGeometry = BoundingBox.ByGeometry(geom=flatten@L1)
byObjectsAndBoundingBoxes = SpacePartitioning.Octree.ByObjectsAndBoundingBoxes(objects=flatten, boundingBoxes=byGeometry)

# group: 4. Use the Octree to quickly find all the cuboids within a range using a bounding box
range_query_x_min = DoubleSlider(0, range=0..8 step 0.1)
range_query_y_min = DoubleSlider(0, range=0..8 step 0.1)
range_query_x_max = DoubleSlider(1.5, range=0..8 step 0.1)
range_query_y_max = DoubleSlider(6.3, range=0..8 step 0.1)
code_block_2 = CodeBlock(a=range_query_x_min, b=range_query_y_min, c=range_query_x_max, d=range_query_y_max) { Point.ByCoordinates(a,b,0); Point.ByCoordinates(c,d,4); }
byCorners_2 = BoundingBox.ByCorners(min=code_block_2.out0, max=code_block_2.out1)
findObjectsIntersectingBoundingBox = SpacePartitioning.Octree.FindObjectsIntersectingBoundingBox(octree=byObjectsAndBoundingBoxes, boundingBox=byCorners_2)
color_palette_2 = ColorPalette({R: 186, G: 85, B: 211, A: 255})
byGeometryColor_2 = Modifiers.GeometryColor.ByGeometryColor(geometry=findObjectsIntersectingBoundingBox, color=color_palette_2)

# group: 3. Use the Octree to quickly find all the cuboids within a certain distance from a point
code_block_3 = CodeBlock { p = Point.ByCoordinates(5.5,5.5,5.5); }
radius_query = DoubleSlider(1.6, range=0..3 step 0.02)
findObjectsWithinRadius = SpacePartitioning.Octree.FindObjectsWithinRadius(octree=byObjectsAndBoundingBoxes, testPoint=code_block_3, testRadius=radius_query)
color_palette_3 = ColorPalette({R: 220, G: 20, B: 60, A: 255})
byGeometryColor_3 = Modifiers.GeometryColor.ByGeometryColor(geometry=findObjectsWithinRadius, color=color_palette_3)
byCenterPointRadius = Sphere.ByCenterPointRadius(centerPoint=code_block_3, radius=radius_query)
color_palette_4 = ColorPalette({R: 220, G: 20, B: 60, A: 45})
byGeometryColor_4 = Modifiers.GeometryColor.ByGeometryColor(geometry=byCenterPointRadius, color=color_palette_4)
